# Grasshopper definition Mqtt-Communication.ghx (Grasshopper 1.0.7)

tablemenu_area = Rectangle({Plane=PlaneXY(0.2491139817, -0.0375, 0), Size=Domain2(u=-0.1312275416..0.1312275416, v=-0.0475..0.0475)})
ar_marker = ARMarker()

topic_to_subscribe = Panel("/kit_handtracking_drawings/")
# Drawings from Unity
host_name = Panel("broker.hivemq.com")
mqtt_subscriber = MQTTSubscriber(host=host_name, topic=topic_to_subscribe, reset=Button())  # -> out, last_message
# ---------- mqtt_subscriber: Python ----------
#Subscriber Component Imports
from __future__ import print_function
import time
import json
import random
import threading
from System.Threading.Tasks import Task
from System.Threading import ManualResetEventSlim

from ghpythonlib.componentbase import executingcomponent as component
from scriptcontext import sticky as st

from compas_eve import Message, Topic, Subscriber
from compas_eve.mqtt import MqttTransport
from compas_ghpython import create_id
from compas_ghpython.timer import update_component

import Rhino
import System


class BackgroundWorker(object):
    """A class representing a background worker for performing asynchronous tasks."""
    def __init__(self, ghenv):
        super(BackgroundWorker, self).__init__()
        self.ghenv = ghenv
        self._is_working = False
        self._is_done = False
        self._is_cancelled = False
        self._has_requested_cancellation = False

    def is_working(self):
        return self._is_working

    def is_done(self):
        return self._is_done

    def has_requested_cancellation(self):
        return self._has_requested_cancellation

    def request_cancellation(self):
        self._has_requested_cancellation = True
        self.thread.join(timeout=3)

    def start_work(self):
        self.thread = threading.Thread(target=self.do_work)
        self.thread.start()

    def set_internal_state_to_working(self):
        self._is_working = True
        self._is_done = False
        self._is_cancelled = False

    def set_internal_state_to_done(self, result):
        self._is_working = False
        self._is_done = True
        self._is_cancelled = False
        self.result = result
        update_component(self.ghenv, 1)

    def set_internal_state_to_cancelled(self):
        self._is_working = False
        self._is_done = False
        self._is_cancelled = True
        
    def do_work(self):
        pass

    def display_progress(self, progress):
        self.display_message("Progress {:.1f}%".format(progress * 100))

    def display_message(self, message):
        def ui_callback():
            self.ghenv.Component.Message = message
            self.ghenv.Component.OnDisplayExpired(True)
        Rhino.RhinoApp.InvokeOnUiThread(System.Action(ui_callback))

    @classmethod
    def instance_by_component(cls, ghenv, force_new=False):
        """Get the worker instance assigned to the component.
        
        This will get a persistant instance of a background worker
        for a given component. For debugging purposes, `force_new` can
        be set to `True` to request a new instance to be created.
        """
        key = create_id(ghenv.Component, 'background_worker')
        worker = st.get(key)

        if worker and force_new:
            worker.request_cancellation()
            worker.display_message("Cancelled")
            del st[key]

        if not worker:
            worker = cls(ghenv)
            st[key] = worker
        
        return worker


class SimpleExampleBackgroundWorker(BackgroundWorker):
    def do_work(self):
        """Perform the actual work in a background thread."""
        
        # This is only an example of how to write a "do_work" method in a background worker,
        # the code can do whatever, it can be blocking if needed, long/running, anything,
        # the important part is that it calls the methods `set_internal_state_to_*`
        # at the right times
        self.set_internal_state_to_working()

        t = 200
        result = dict()
        for i in range(t):
            if self.has_requested_cancellation():
                self.display_message("Cancelled")
                self.set_internal_state_to_cancelled()
                break

            self.display_progress(i / (t-1))
            time.sleep(.1)

            result['a'] = "Counted up to {}".format(t)

        self.set_internal_state_to_done(result)




class SubscriberBackgroundWorker(BackgroundWorker):
    def do_work(self):
        self.set_internal_state_to_working()
        results = {"messages": []}
        self.messages = results["messages"]
        
        def on_message(message):
            try:
                results["messages"].append(message)
                update_component(self.ghenv, 1)
            except Exception as e:
                self.display_message("Exception: {}".format(e))

        tx = MqttTransport(self.host)
        subscriber = Subscriber(Topic(self.topic, Message), callback=on_message, transport=tx)
        subscriber.subscribe()

        try:
            self.display_message("Starting...")
            while True:
                self.display_message("Received {} messages".format(len(results["messages"])))
                if self.has_requested_cancellation():
                    self.display_message("Cancelled")
                    self.set_internal_state_to_cancelled()
                    break
                
                time.sleep(0.5)
        except Exception as e:
            self.display_message("Exception in threaded worker: " + str(e))
        finally:
            subscriber.unsubscribe()

        self.set_internal_state_to_done(results)

class SubscriberComponent(component):
    def RunScript(self, host, topic, reset):
        self.worker = SubscriberBackgroundWorker.instance_by_component(ghenv, force_new=reset)
        self.worker.host = host
        self.worker.topic = topic

        if not self.worker.is_working() and not self.worker.is_done():
            self.worker.display_message("Starting work..")
            time.sleep(.5)

            self.worker.start_work()

        print("is_working", self.worker.is_working())
        print("is_done", self.worker.is_done())

        last_message = None
        if hasattr(self.worker, "messages") and len(self.worker.messages):
            last_message = self.worker.messages[-1].data["result"]
            print("Received {} total messages".format(len(self.worker.messages)))
            #for msg in self.worker.messages:
                 #print("Request #{}".format(msg))

        return (last_message, )
# ---------- end mqtt_subscriber ----------
visualize = GhPythonScript(result=mqtt_subscriber.last_message)  # -> out, drawings
# ---------- visualize: Python ----------
from compas.geometry import Point, NurbsCurve, Frame, Transformation, Polyline
import ghpythonlib.treehelpers as th

drawings =[]

if (result):
    lines =[]
    frame = Frame(result["frame"]["point"], result["frame"]["xaxis"], result["frame"]["yaxis"])
    T = Transformation.from_frame_to_frame(frame, Frame.worldXY())
    for key, vl in result["lines"].items():
        if (len(vl)>2):
            line_MCF = NurbsCurve.from_points(vl,1) # line in Markers Coordinate System
            line_WCF = line_MCF.transformed(T)
            lines.append(line_WCF)
        
    drawings.append(lines)

drawings = th.list_to_tree(drawings)
# ---------- end visualize ----------
draw = Draw(cg=visualize.drawings)  # -> rg
#   port cg: The COMPAS geometry or datastructure to be drawn.
#   port rg: The Rhino geometry object.
# ---------- draw: Python ----------
"""
Draws COMPAS geometry in Grasshopper.
"""

from ghpythonlib.componentbase import executingcomponent as component

from compas.scene import SceneObject


class CompasToRhinoGeometry(component):
    def RunScript(self, cg):
        if not cg:
            return None

        return SceneObject(cg).draw()
# ---------- end draw ----------

# ----
# Mesh to JSON (for reading it in Unity) - WIP
panel = Panel("Log_Test")
triangulated_mesh = Mesh(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)
dict_from_mesh = GhPythonScript(mesh=triangulated_mesh, name=panel)  # -> data; inputs mesh: Mesh
# ---------- dict_from_mesh: Python ----------
import Rhino.Geometry as rg

data ={}
data["name"] = name

list_faces =[]
for f in mesh.Faces:
    face = [f[0], f[1], f[2]]
    list_faces.append(face)
data["faces"] = list_faces

list_vertices =[]
for v in mesh.Vertices:
    vertex=[v.X, v.Y, v.Z]
    list_vertices.append(vertex)
data["vertices"] = list_vertices

list_normals =[]
for n in mesh.Normals:
    normal=[n.X, n.Y, n.Z]
    list_normals.append(normal)
data["normals"] = list_normals

list_uv =[]
for u in mesh.TextureCoordinates:
    uv=[u.X, u.Y]
    list_uv.append(uv)
data["uv"] = list_uv

print data["faces"][2], data["vertices"][1] 
print data["normals"][20]
print data["uv"][20]

data =[data]
# ---------- end dict_from_mesh ----------
to_json = ToJSON(data=dict_from_mesh, file_name=panel, pretty=Toggle(True), save=Button())  # -> json; inputs pretty: Boolean
#   port data: COMPAS data objects to serialize.
#   port pretty: If True, JSON data will be formatted with indentation and key sorting.
#   port json: JSON file path or JSON string.
# ---------- to_json: Python ----------
"""
Serializes COMPAS objects to JSON.
"""

from ghpythonlib.componentbase import executingcomponent as component
import compas
import os
import Rhino

class CompasInfo(component):
    def RunScript(self, data, file_name, pretty, save):
        # Get the folder path of the current Grasshopper document
        gh_document = self.OnPingDocument()
        if gh_document is not None:
            base_folder = os.path.dirname(gh_document.FilePath)
        else:
            base_folder = ""
        
        # Define the relative path to the 'data' folder
        data_folder_relative_path = os.path.join("..", "data")
        data_folder_path = os.path.abspath(os.path.join(base_folder, data_folder_relative_path))
        
        # Create the 'data' folder if it does not exist
        if not os.path.exists(data_folder_path):
            os.makedirs(data_folder_path)
        
        # Construct the file path inside the 'data' folder
        filepath = os.path.join(data_folder_path, file_name + ".json")
        json = filepath
        if save:
            if filepath:
                compas.json_dump(data, filepath, pretty)
            else:
                json = compas.json_dumps(data, pretty)

        return json
# ---------- end to_json ----------
custom_preview = CustomPreview(Geometry=triangulated_mesh, Material=ColourSwatch(SwatchColor=RGBA(186, 186, 186, 4)))

# ==== cluster ARMarker
ar_marker = Rectangle({Plane=PlaneXY(0.0375, -0.0375, 0), Size=Domain2(u=-0.0375..0.0375, v=-0.0375..0.0375)})
border = OffsetCurve(Curve=ar_marker, Distance="0.01", Corners=1)
geometry = Geometry([border, ar_marker])
geometry_2 = ClusterOutput(geometry)
